# Grasshopper definition finalDongyub.gh (Grasshopper 1.0.7)
# plug-ins: Kangaroo2 Components

mesh = Mesh([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])
mesh_2 = Mesh([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])
combine_clean = CombineClean(Meshes=mesh)
combine_clean_2 = CombineClean(Meshes=mesh_2)

mesh_3 = Mesh(combine_clean)
mesh_4 = Mesh(combine_clean_2)

number_slider = Slider(0.04, range=0..0.1)
number_slider_2 = Slider(1.03, range=1..1.1)
subtraction = Subtraction(A=Slider(0.15, range=0..0.5), B=number_slider)
thickness = GetNumber(Slider(100, range=0..100), AtLeast=1, AtMost=2147483647, Maximum=1.797693135e+308, Minimum=-1.797693135e+308)
subtraction_2 = Subtraction(A=Slider(1.1, range=1..1.5), B=number_slider_2)
division = Division(A=subtraction, B=Slider(100, range=0..100))
division_2 = Division(A=subtraction_2, B=Slider(100, range=0..100))
multiplication = Multiplication(A=division, B=thickness)
multiplication_2 = Multiplication(A=division_2, B=thickness)
addition = Addition(A=multiplication, B=number_slider)
addition_2 = Addition(A=multiplication_2, B=number_slider_2)
multiplication_3 = Multiplication(A=addition_2, B=1.003)
scale = Scale(Geometry=mesh_4, Center=Point(0, 0, 0), Factor=multiplication_3)  # -> Geometry, Transform
scale_2 = Scale(Geometry=mesh_3, Center=Point(0, 0, 0), Factor=multiplication_3)  # -> Geometry, Transform
scale_3 = Scale(Geometry=mesh_4, Center=Point(0, 0, 0), Factor=addition_2)  # -> Geometry, Transform
scale_4 = Scale(Geometry=mesh_4, Center=Point(0, 0, 0), Factor=Slider(1, range=0..10))  # -> Geometry, Transform
scale_5 = Scale(Geometry=mesh_4, Center=Point(0, 0, 0), Factor=addition_2)  # -> Geometry, Transform
scale_6 = Scale(Geometry=mesh_4, Center=Point(0, 0, 0), Factor=multiplication_3)  # -> Geometry, Transform
scale_7 = Scale(Geometry=mesh_3, Center=Point(0, 0, 0), Factor=multiplication_3)  # -> Geometry, Transform
mesh_edges = MeshEdges(Mesh=scale.Geometry)  # -> NakedEdges, InteriorEdges, NonManifoldEdges
mesh_edges_2 = MeshEdges(Mesh=scale_2.Geometry)  # -> NakedEdges, InteriorEdges, NonManifoldEdges
mesh_edges_3 = MeshEdges(Mesh=scale_3.Geometry)  # -> NakedEdges, InteriorEdges, NonManifoldEdges
join_curves = JoinCurves(Curves=[mesh_edges.NakedEdges, mesh_edges.InteriorEdges], Preserve=False)
join_curves_2 = JoinCurves(Curves=mesh_edges_2.NakedEdges, Preserve=False)
join_curves_3 = JoinCurves(Curves=[mesh_edges_3.NakedEdges, mesh_edges_3.InteriorEdges], Preserve=False)
multiplication_4 = Multiplication(A=addition, B=2)
multiplication_5 = Multiplication(A=addition, B=3)
number_slider_3 = Slider(0, range=0..1.1)
multipipe = MultiPipe(Curves=join_curves, NodeSize=multiplication_4, EndOffset=1, StrutSize=1, Segment=0, KinkAngle=0.6, CubeFit=0)
multipipe_2 = MultiPipe(Curves=join_curves_2, NodeSize=multiplication_5, EndOffset=1, StrutSize=1, Segment=0, KinkAngle=0.6, CubeFit=0)
multipipe_3 = MultiPipe(Curves=join_curves_3, NodeSize=addition, EndOffset=1, StrutSize=1, Segment=0, KinkAngle=0.6, CubeFit=0)
height = GetNumber(Slider(100, range=0..100), AtLeast=1, AtMost=2147483647, Maximum=1.797693135e+308, Minimum=-1.797693135e+308)
subtraction_3 = Subtraction(A=Slider(4, range=1..5), B=number_slider_3)
meshsubd = MeshFromSubD(SubD=multipipe_3, Density=1)
meshsubd_2 = MeshFromSubD(SubD=multipipe, Density=1)
meshsubd_3 = MeshFromSubD(SubD=multipipe_2, Density=1)
division_3 = Division(A=subtraction_3, B=Slider(100, range=0..100))
mesh_5 = Mesh(scale_5.Geometry)
mesh_6 = Mesh(scale_7.Geometry)
mesh_7 = Mesh(scale_6.Geometry)

mesh_8 = Mesh(meshsubd_3)
mesh_9 = Mesh(meshsubd)
mesh_10 = Mesh(meshsubd_2)

multiplication_6 = Multiplication(A=division_3, B=height)
colour_picker = ColourPicker(PickedColour=RGB(255, 255, 255))
colour_picker_2 = ColourPicker(PickedColour=RGB(154, 173, 153))
colour_picker_3 = ColourPicker(PickedColour=RGB(158, 120, 120))
colour_picker_4 = ColourPicker(PickedColour=RGB(94, 110, 115))
addition_3 = Addition(A=multiplication_6, B=number_slider_3)
colour_picker_5 = ColourPicker(PickedColour=RGB(225, 227, 232))
colour_picker_6 = ColourPicker(PickedColour=RGB(255, 207, 255))
colour_picker_7 = ColourPicker(PickedColour=RGB(245, 242, 198))
create_material = CreateMaterial(Diffuse=colour_picker, Specular=RGB(255, 255, 255), Emission=RGB(0, 0, 0), Transparency=0, Shine=0)
create_material_2 = CreateMaterial(Diffuse=colour_picker_2, Specular=RGB(255, 255, 255), Emission=RGB(0, 0, 0), Transparency=0, Shine=0)
create_material_3 = CreateMaterial(Diffuse=colour_picker_6, Specular=RGB(255, 255, 255), Emission=RGB(0, 0, 0), Transparency=0, Shine=0)
create_material_4 = CreateMaterial(Diffuse=colour_picker_3, Specular=RGB(255, 255, 255), Emission=RGB(0, 0, 0), Transparency=0, Shine=0)
create_material_5 = CreateMaterial(Diffuse=colour_picker_5, Specular=RGB(255, 255, 255), Emission=RGB(0, 0, 0), Transparency=0, Shine=0)
create_material_6 = CreateMaterial(Diffuse=colour_picker_4, Specular=RGB(255, 255, 255), Emission=RGB(0, 0, 0), Transparency=0, Shine=0)
create_material_7 = CreateMaterial(Diffuse=colour_picker_7, Specular=RGB(255, 255, 255), Emission=RGB(0, 0, 0), Transparency=0, Shine=0)
addition_4 = Addition(A=addition_3, B=addition_3)
addition_5 = Addition(A=addition_4, B=addition_3)
addition_6 = Addition(A=addition_5, B=addition_3)
addition_7 = Addition(A=addition_6, B=addition_3)
addition_8 = Addition(A=addition_7, B=addition_3)
unit_z = UnitZ(Factor=addition_6)
unit_z_2 = UnitZ(Factor=addition_7)
unit_z_3 = UnitZ(Factor=addition_4)
unit_z_4 = UnitZ(Factor=addition_3)
unit_z_5 = UnitZ(Factor=addition_8)
unit_z_6 = UnitZ(Factor=addition_5)
move = Move(Geometry=mesh_9, Motion=unit_z_4)  # -> Geometry, Transform
move_2 = Move(Geometry=mesh_5, Motion=unit_z_3)  # -> Geometry, Transform
move_3 = Move(Geometry=mesh_10, Motion=unit_z_6)  # -> Geometry, Transform
move_4 = Move(Geometry=mesh_7, Motion=unit_z)  # -> Geometry, Transform
move_5 = Move(Geometry=mesh_6, Motion=unit_z_2)  # -> Geometry, Transform
move_6 = Move(Geometry=mesh_8, Motion=unit_z_5)  # -> Geometry, Transform
mesh_11 = Mesh(scale_4.Geometry)

# ---- group: edge
c_script = CSharpScript(theMesh=move_2.Geometry, theStringA="edge", theStringB="1")  # -> out, A; inputs theMesh: Mesh, theStringA: String, theStringB: String
# ---------- c_script: C# ----------
    theMesh.SetUserString(theStringA, theStringB);
    A = theMesh;
# ---------- end c_script ----------

c_script_2 = CSharpScript(theMesh=move_4.Geometry, theStringA="edge", theStringB="1")  # -> out, A; inputs theMesh: Mesh, theStringA: String, theStringB: String; same code as c_script

# ---- group: flat
c_script_3 = CSharpScript(theMesh=move_3.Geometry, theStringA="flat", theStringB="1")  # -> out, A; inputs theMesh: Mesh, theStringA: String, theStringB: String; same code as c_script

c_script_4 = CSharpScript(theMesh=move_6.Geometry, theStringA="flat", theStringB="1")  # -> out, A; inputs theMesh: Mesh, theStringA: String, theStringB: String; same code as c_script

# ---- group: motionY
c_script_5 = CSharpScript(theMesh=move_5.Geometry, theStringA="motionY", theStringB="1")  # -> out, A; inputs theMesh: Mesh, theStringA: String, theStringB: String; same code as c_script

# ---- group: motionX
c_script_6 = CSharpScript(theMesh=c_script_3.A, theStringA="motionX", theStringB="1")  # -> out, A; inputs theMesh: Mesh, theStringA: String, theStringB: String; same code as c_script

# ----
merge = Merge(
    Data1=mesh_11,
    Data2=move.Geometry,
    Data3=c_script.A,
    Data4=c_script_6.A,
    Data5=c_script_2.A,
    Data6=c_script_5.A,
    Data7=c_script_4.A)
merge_2 = Merge(
    Data1=create_material_6,
    Data2=create_material_7,
    Data3=create_material_5,
    Data4=create_material_2,
    Data5=create_material_4,
    Data6=create_material_3,
    Data7=create_material)  # -> simplify(flatten(Result))
panel = Panel(merge_2)
mesh_12 = Mesh(flatten(merge))
panel_2 = Panel(mesh_12)
c_script_7 = CSharpScript(objects=simplify(graft(mesh_12)), materials=simplify(graft(merge_2)))  # -> out, str; inputs objects: tree, materials: tree
# ---------- c_script_7: C# ----------
    if(objects.BranchCount != materials.BranchCount) return;

    var doc = new Rhino.FileIO.File3dm();

    //go through branches
    for(int i = 0; i < objects.BranchCount; i++)
    {
      var mat = materials.Branches[i][0] as Rhino.Display.DisplayMaterial;
      var objs = objects.Branches[i];

      var material = new Rhino.DocObjects.Material();
      material.DiffuseColor = mat.Diffuse;
      material.EmissionColor = mat.Emission;
      material.Transparency = mat.Transparency;
      material.Shine = mat.Shine;
      material.SpecularColor = mat.Specular;

      var atts = new Rhino.DocObjects.ObjectAttributes();
      atts.MaterialSource = Rhino.DocObjects.ObjectMaterialSource.MaterialFromObject;

      doc.AllMaterials.Add(material);
      atts.MaterialIndex = i;

      for(int j = 0; j < objs.Count; j++)
      {
        var obj = objs[j] as Rhino.Geometry.GeometryBase;
        Print(obj.ToString());

        switch(obj.ObjectType)
        {
          case Rhino.DocObjects.ObjectType.Curve:
            doc.Objects.AddCurve(obj as Curve, atts);
            break;
          case Rhino.DocObjects.ObjectType.Mesh:
            doc.Objects.AddMesh(obj as Mesh, atts);
            break;
        }
      }

    }

    var fwo = new Rhino.FileIO.File3dmWriteOptions();
    fwo.Version = 7;
    var arr = doc.ToByteArray(fwo);

    str = Convert.ToBase64String(arr);

    doc.Dispose();
# ---------- end c_script_7 ----------

# ---- group: RH_OUT:docString
txt = Text(c_script_7.str)

# ----
panel_3 = Panel("RH_OUT:docString")
